# Dynamo graph 修改标高.dyn (Dynamo 2.1.0.7500)

select_model_elements = DSModelElementsSelection()  # 6 picked in the model; graph input
parameters = Element.Parameters(element=select_model_elements)
name = Parameter.Name(parameter=parameters)
code_block = CodeBlock { "参照标高"; }
eq = name == code_block
allFalse = List.AllFalse(list=eq@L2)
filterByBoolMask = List.FilterByBoolMask(list=select_model_elements, mask=allFalse)
string = StringInput("参照标高")
levels = Levels("标高 1")  # graph input
setParameterByName = Element.SetParameterByName(element=filterByBoolMask.out, parameterName=string, value=levels)
parameters_2 = Element.Parameters(element=filterByBoolMask.in)
id = Parameter.Id(parameter=parameters_2)
code_block_2 = CodeBlock { -1001352; }
eq_2 = id == code_block_2
filterByBoolMask_2 = List.FilterByBoolMask(list=parameters_2, mask=eq_2)
flatten = List.Flatten(list=filterByBoolMask_2.in)
setValue = Parameter.SetValue(parameter=flatten, value=levels)
