# Dynamo graph 填写材料信息.dyn (Dynamo 2.0.1.5055)

物体选择 = DSModelElementsSelection()  # 2 picked in the model; graph input
getMaterials = Element.GetMaterials(element=物体选择)
name = Material.Name(material=getMaterials)
parameters = Element.Parameters(element=getMaterials)
code_block = CodeBlock { 0; }
code_block_2 = CodeBlock { "材料代码"; }
getParameterValueByName = Element.GetParameterValueByName(element=getMaterials, parameterName=code_block_2)
length = String.Length(str=getParameterValueByName)
ne = code_block != length
boolean = BoolSelector(true)  # graph input
contains = List.Contains(list=ne@L2, item=boolean)
filterByBoolMask = List.FilterByBoolMask(list=物体选择, mask=contains)
filterByBoolMask_2 = List.FilterByBoolMask(list=getMaterials, mask=ne)
isEmpty = List.IsEmpty(list=filterByBoolMask_2.in@L2)
filterByBoolMask_3 = List.FilterByBoolMask(list=filterByBoolMask_2.in, mask=isEmpty)

# group: 材料代码
code_block_3 = CodeBlock { 2; }
normalizeDepth = List.NormalizeDepth(list=filterByBoolMask.in, rank=code_block_3)
code_block_4 = CodeBlock { "材料代码"; }
code_block_5 = CodeBlock { "材料代码"; }
getParameterValueByName_2 = Element.GetParameterValueByName(element=filterByBoolMask_3.out@L1, parameterName=code_block_5@L1, lacing=CrossProduct)
setParameterByName = Element.SetParameterByName(element=normalizeDepth, parameterName=code_block_4@L1, value=getParameterValueByName_2@L3)

watch = Watch(物体选择)

# group: 材料编号
code_block_6 = CodeBlock { 2; }
normalizeDepth_2 = List.NormalizeDepth(list=filterByBoolMask.in, rank=code_block_6)
code_block_7 = CodeBlock { "材料编号"; }
code_block_8 = CodeBlock { "材料编号"; }
getParameterValueByName_3 = Element.GetParameterValueByName(element=filterByBoolMask_3.out@L1, parameterName=code_block_8@L1, lacing=CrossProduct)
setParameterByName_2 = Element.SetParameterByName(element=normalizeDepth_2, parameterName=code_block_7@L1, value=getParameterValueByName_3@L3)

# group: 防火等级
code_block_9 = CodeBlock { 2; }
normalizeDepth_3 = List.NormalizeDepth(list=filterByBoolMask.in, rank=code_block_9)
code_block_10 = CodeBlock { "防火等级"; }
code_block_11 = CodeBlock { "防火等级"; }
getParameterValueByName_4 = Element.GetParameterValueByName(element=filterByBoolMask_3.out@L1, parameterName=code_block_11@L1, lacing=CrossProduct)
setParameterByName_3 = Element.SetParameterByName(element=normalizeDepth_3, parameterName=code_block_10@L1, value=getParameterValueByName_4@L3)

# group: 应用部位
code_block_12 = CodeBlock { 2; }
normalizeDepth_4 = List.NormalizeDepth(list=filterByBoolMask.in, rank=code_block_12)
code_block_13 = CodeBlock { "应用部位"; }
code_block_14 = CodeBlock { "应用部位"; }
getParameterValueByName_5 = Element.GetParameterValueByName(element=filterByBoolMask_3.out@L1, parameterName=code_block_14@L1, lacing=CrossProduct)
setParameterByName_4 = Element.SetParameterByName(element=normalizeDepth_4, parameterName=code_block_13@L1, value=getParameterValueByName_5@L3)

watch_2 = Watch(filterByBoolMask.in)

# group: 材料名称
code_block_15 = CodeBlock { 2; }
normalizeDepth_5 = List.NormalizeDepth(list=filterByBoolMask.in, rank=code_block_15)
code_block_16 = CodeBlock { "材料名称"; }
setParameterByName_5 = Element.SetParameterByName(element=normalizeDepth_5, parameterName=code_block_16@L1, value=filterByBoolMask_3.out@L3)
